# Grasshopper definition 240401-GH-SampleScript.gh (Grasshopper 1.0.7)
# plug-ins: Rhino.Inside for Autodesk Revit, Pufferfish

# ---- group: Garis Acuan Facade dari Model Revit
graphical_element = GraphicalElement([<curveelement referenced from the Revit model> x2])
curve = Curve(graphical_element)

# ---- group: Massa Bangunan dari Model Revit
graphical_element_2 = GraphicalElement([<floor referenced from the Revit model> x3, <wall referenced from the Revit model> x5, <panel referenced from the Revit model>, <curtaingridline referenced from the Revit model>, <panel referenced from the Revit model>, <curtaingridline referenced from the Revit model>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])

# ---- group: Memindahkan Garis Acuan
levels_picker = LevelsPicker(<levels picker referenced from the Revit model>)
levels_picker_2 = LevelsPicker(<levels picker referenced from the Revit model>)
move_to_point = MoveToPoint(Geometry=curve, PointA=levels_picker_2, PointB=levels_picker)  # -> Moved, Vector, Transform

# ---- group: Membuat Bidang untuk Facade
unit_z = UnitZ(Factor=Slider(8000, range=0..10000))
extrude = Extrude(Base=move_to_point.Moved, Direction=unit_z)

# ----
deconstruct_brep = DeconstructBrep(Brep=extrude)  # -> Faces, Edges, Vertices

# ---- group: Membuat Geometri Facade
surface = Surface(deconstruct_brep.Faces)
line = Line(deconstruct_brep.Edges)
divide_surface = DivideSurface(Surface=surface, UCount=Slider(25, range=0..50), VCount=10)  # -> Points, Normals, Parameters
polyline = PolyLine(Vertices=divide_surface.Points, Closed=False)
pipe = Pipe(Curve=polyline, Radius=Slider(60, range=0..200), Caps=0)
pipe_2 = Pipe(Curve=line, Radius=Slider(100, range=0..200), Caps=0)

# ---- group: Mengatur Material
query_materials = QueryMaterials(Name="Wood")
panel = Panel(query_materials)
material_graphics = MaterialGraphics(Material=query_materials)  # -> Material, UseRenderAppearance, Color, Transparency, SurfacePatternsForegroundPattern, SurfacePatternsForegroundColor, CutPatternsForegroundPattern, CutPatternsForegroundColor

# ----
built_in_categories = BuiltInCategories("autodesk.revit.category.local:curtaSystem-1.0.0", SearchPattern="curtain")

# ---- group: Menghubungkan Geometri Facade ke Model Revit
add_directshape_geometry = AddDirectShapeGeometry(Category=built_in_categories, Geometry=[pipe, pipe_2], Material=material_graphics.Material, TrackingMode=2)
